# Grasshopper definition wasp--4.2.gh (Grasshopper 1.0.7)
# plug-ins: Human, RugOscGH, RhinoCodePluginGH

connections_centers = Point([<point referenced from the Rhino model> x2])
connections_x_axis = Curve([<curve referenced from the Rhino model> x2])
part_geometry = Brep(<brep referenced from the Rhino model>)
connections_centers_2 = Point([<point referenced from the Rhino model> x4])
part_geometry_2 = Brep(<brep referenced from the Rhino model>)
connections_x_axis_2 = Curve([<curve referenced from the Rhino model> x4])
connections_centers_3 = Point([<point referenced from the Rhino model> x4])
connections_x_axis_3 = Curve([<curve referenced from the Rhino model> x4])
part_geometry_3 = Brep(<brep referenced from the Rhino model>)
connections_centers_4 = Point([<point referenced from the Rhino model> x2])
connections_centers_5 = Point([<point referenced from the Rhino model> x2])
connections_x_axis_4 = Curve([<curve referenced from the Rhino model> x2])
connections_x_axis_5 = Curve([<curve referenced from the Rhino model> x2])
part_geometry_4 = Brep(<brep referenced from the Rhino model>)
connections_x_axis_6 = Curve([<curve referenced from the Rhino model> x2])
connections_centers_6 = Point([<point referenced from the Rhino model> x2])
part_geometry_5 = Brep(<brep referenced from the Rhino model>)
part_geometry_6 = Brep(<brep referenced from the Rhino model>)
part_geometry_7 = Brep(<brep referenced from the Rhino model>)
connections_centers_7 = Point([<point referenced from the Rhino model> x4])
connections_x_axis_7 = Curve([<curve referenced from the Rhino model> x4])
part_name = Panel("A")
points = PointList(Points=connections_centers, Size=Slider(2, range=0..10))
part_name_2 = Panel("B")
points_2 = PointList(Points=connections_centers_2, Size=Slider(5, range=0..10))
conndir = Wasp_ConnectionFromDirection(GEO=part_geometry_3, CEN=connections_centers_3, UP=connections_x_axis_3)  # -> CONN, PLN_OUT; inputs GEO: Mesh, CEN: list of Point3d, UP: list of Curve, T: list; plug-in component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
conndir_2 = Wasp_ConnectionFromDirection(GEO=part_geometry_2, CEN=connections_centers_2, UP=connections_x_axis_2)  # -> CONN, PLN_OUT; inputs GEO: Mesh, CEN: list of Point3d, UP: list of Curve, T: list; plug-in component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
part_name_3 = Panel("C")
conndir_3 = Wasp_ConnectionFromDirection(GEO=part_geometry, CEN=connections_centers, UP=connections_x_axis)  # -> CONN, PLN_OUT; inputs GEO: Mesh, CEN: list of Point3d, UP: list of Curve, T: list; plug-in component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
conndir_4 = Wasp_ConnectionFromDirection(GEO=part_geometry_4, CEN=connections_centers_4, UP=connections_x_axis_4)  # -> CONN, PLN_OUT; inputs GEO: Mesh, CEN: list of Point3d, UP: list of Curve, T: list; plug-in component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
conndir_5 = Wasp_ConnectionFromDirection(GEO=part_geometry_5, CEN=connections_centers_5, UP=connections_x_axis_5)  # -> CONN, PLN_OUT; inputs GEO: Mesh, CEN: list of Point3d, UP: list of Curve, T: list; plug-in component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
part_name_4 = Panel("A")
points_3 = PointList(Points=connections_centers_6, Size=Slider(2, range=0..10))
part_name_5 = Panel("E")
points_4 = PointList(Points=connections_centers_3, Size=Slider(1, range=0..10))
part_name_6 = Panel("E")
points_5 = PointList(Points=connections_centers_7, Size=Slider(5, range=0..10))
part_name_7 = Panel("B")
conndir_6 = Wasp_ConnectionFromDirection(GEO=part_geometry_7, CEN=connections_centers_7, UP=connections_x_axis_7)  # -> CONN, PLN_OUT; inputs GEO: Mesh, CEN: list of Point3d, UP: list of Curve, T: list; plug-in component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
conndir_7 = Wasp_ConnectionFromDirection(GEO=part_geometry_6, CEN=connections_centers_6, UP=connections_x_axis_6)  # -> CONN, PLN_OUT; inputs GEO: Mesh, CEN: list of Point3d, UP: list of Curve, T: list; plug-in component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
points_6 = PointList(Points=connections_centers_4, Size=Slider(1, range=0..10))
points_7 = PointList(Points=connections_centers_5, Size=Slider(1, range=0..10))
part = Wasp_BasicPart(NAME=part_name_3, GEO=part_geometry_3, CONN=flatten(conndir.CONN))  # -> PART; inputs GEO: Mesh, CONN: list, ATTR: list; plug-in component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
part_2 = Wasp_BasicPart(NAME=part_name_2, GEO=part_geometry_2, CONN=flatten(conndir_2.CONN))  # -> PART; inputs GEO: Mesh, CONN: list, ATTR: list; plug-in component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
part_3 = Wasp_BasicPart(NAME=part_name, GEO=part_geometry, CONN=flatten(conndir_3.CONN))  # -> PART; inputs GEO: Mesh, CONN: list, ATTR: list; plug-in component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
part_4 = Wasp_BasicPart(NAME=part_name_6, GEO=part_geometry_5, CONN=flatten(conndir_5.CONN))  # -> PART; inputs GEO: Mesh, CONN: list, ATTR: list; plug-in component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
split = TextSplit(Separators=",")
part_5 = Wasp_BasicPart(NAME=part_name_5, GEO=part_geometry_4, CONN=flatten(conndir_4.CONN))  # -> PART; inputs GEO: Mesh, CONN: list, ATTR: list; plug-in component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
part_6 = Wasp_BasicPart(NAME=part_name_7, GEO=part_geometry_7, CONN=flatten(conndir_6.CONN))  # -> PART; inputs GEO: Mesh, CONN: list, ATTR: list; plug-in component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
part_7 = Wasp_BasicPart(NAME=part_name_4, GEO=part_geometry_6, CONN=flatten(conndir_7.CONN))  # -> PART; inputs GEO: Mesh, CONN: list, ATTR: list; plug-in component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
boolean_toggle = BooleanToggle(True)
item = ListItem(List=split, Index="1", Wrap=True)
merge = Merge(Data1=part_3, Data2=part_2, Data3=part, Data4=part_4)
merge_2 = Merge(Data1=part_7, Data2=part_6, Data4=part_5)
int = Integer(item)
trigger = Trigger(Interval=-1000, TimerInterval=1000)
panel = Panel("15")
part_geometry_8 = Brep(<brep referenced from the Rhino model>)
connections_centers_8 = Point([<point referenced from the Rhino model> x4])
connections_x_axis_8 = Curve([<curve referenced from the Rhino model> x4])
connections_centers_9 = Point([<point referenced from the Rhino model> x4])
connections_x_axis_9 = Curve([<curve referenced from the Rhino model> x4])
part_geometry_9 = Brep(<brep referenced from the Rhino model>)
connections_centers_10 = Point([<point referenced from the Rhino model> x2])
connections_x_axis_10 = Curve([<curve referenced from the Rhino model> x2])
part_geometry_10 = Brep(<brep referenced from the Rhino model>)
button = Button()
file = ReadFile(File="C:\temp\gh_run.txt", PerLineParse=True)
item_2 = ListItem(List=file, Index="1", Wrap=True)
points_8 = PointList(Points=connections_centers_8, Size=Slider(5, range=0..10))
part_name_8 = Panel("B")
conndir_8 = Wasp_ConnectionFromDirection(GEO=part_geometry_9, CEN=connections_centers_9, UP=connections_x_axis_9)  # -> CONN, PLN_OUT; inputs GEO: Mesh, CEN: list of Point3d, UP: list of Curve, T: list; plug-in component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
conndir_9 = Wasp_ConnectionFromDirection(GEO=part_geometry_8, CEN=connections_centers_8, UP=connections_x_axis_8)  # -> CONN, PLN_OUT; inputs GEO: Mesh, CEN: list of Point3d, UP: list of Curve, T: list; plug-in component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
part_name_9 = Panel("C")
conndir_10 = Wasp_ConnectionFromDirection(GEO=part_geometry_10, CEN=connections_centers_10, UP=connections_x_axis_10)  # -> CONN, PLN_OUT; inputs GEO: Mesh, CEN: list of Point3d, UP: list of Curve, T: list; plug-in component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
points_9 = PointList(Points=connections_centers_9, Size=Slider(1, range=0..10))
part_name_10 = Panel("E")
int_2 = Integer(item_2)
panel_2 = Panel(file)
points_10 = PointList(Points=connections_centers_10, Size=Slider(1, range=0..10))
larger = LargerThan(FirstNumber=int_2, SecondNumber="0")  # -> LargerThan, OrEqualTo
oscreceiver = OscReceiver(
    Receive=larger.LargerThan,
    KeepLastData=Toggle(True),
    IPAddress="127.0.0.1",
    Port="12353",
    PacketSize=2048,
    BufferSize=600)
split_2 = TextSplit(Text=oscreceiver, Separators=",")
item_3 = ListItem(List=split_2, Index="9", Wrap=True)
rep = ReplaceText(Text=item_3, Find="f }", RecursiveReplace=False)
int_3 = Integer(rep)
panel_3 = Panel(int_3)
item_4 = ListItem(List=split_2, Index="11", Wrap=True)
panel_4 = Panel(split_2)
item_5 = ListItem(List=panel_4, Index="7", Wrap=True)
rep_2 = ReplaceText(Text=item_4, Find="f }", RecursiveReplace=False)
rep_3 = ReplaceText(Text=item_5, Find="f }", RecursiveReplace=False)
part_8 = Wasp_BasicPart(NAME=part_name_8, GEO=part_geometry_8, CONN=flatten(conndir_9.CONN))  # -> PART; inputs GEO: Mesh, CONN: list, ATTR: list; plug-in component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
part_9 = Wasp_BasicPart(NAME=part_name_9, GEO=part_geometry_9, CONN=flatten(conndir_8.CONN))  # -> PART; inputs GEO: Mesh, CONN: list, ATTR: list; plug-in component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
int_4 = Integer(rep_3)
part_10 = Wasp_BasicPart(NAME=part_name_10, GEO=part_geometry_10, CONN=flatten(conndir_10.CONN))  # -> PART; inputs GEO: Mesh, CONN: list, ATTR: list; plug-in component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
num = Number(rep_2)
item_6 = ListItem(List=panel_4, Index="5", Wrap=True)
path = FilePath()
split_3 = TextSplit(Text=panel_2, Separators=" ")
panel_5 = Panel(int_4)
merge_3 = Merge(Data2=part_8, Data3=part_9, Data4=part_10)
filter = StreamFilter(Gate=panel_3, Stream0=merge, Stream1=merge_2, Stream2=merge_3)
rulegen = Wasp_RulesGenerator(PART=filter)  # -> R; inputs PART: list, SELF_P: Boolean, SELF_C: Boolean, TYP: Boolean, GR: list; plug-in component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
rep_4 = ReplaceText(Text=item_6, Find="f }", RecursiveReplace=False)
int_5 = Integer(rep_4)
panel_6 = Panel(int_5)
larger_2 = LargerThan(FirstNumber=num, SecondNumber="0.5")  # -> LargerThan, OrEqualTo
stochasticaggregation = Wasp_StochasticAggregation(PART=flatten(filter), N=panel_6, RULES=rulegen, SEED=panel_5, RESET=larger_2.LargerThan)  # -> AGGR, PART_OUT; inputs PART: list, PREV: list, N: Int32, RULES: list, SEED: Int32, MODE: Int32, GC: list, RESET: Boolean; plug-in component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
panel_7 = Panel(larger.LargerThan)
boolean_toggle_2 = BooleanToggle(True)
boolean_toggle_3 = BooleanToggle(True)
partgeo = Wasp_GetPartGeometry(PART=stochasticaggregation.PART_OUT)  # -> GEO; plug-in component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
partgeo_2 = Wasp_GetPartGeometry(PART=stochasticaggregation.PART_OUT)  # -> GEO; plug-in component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
list_item = ListItem(List=partgeo_2, Index=0, Wrap=True)
lng = ListLength(List=partgeo)
namefilter = Wasp_FilterPartsByName(PART=stochasticaggregation.PART_OUT, NAME="A")  # -> PART_OUT, MASK; inputs PART: list, NAME: list; plug-in component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
partgeo_3 = Wasp_GetPartGeometry(PART=namefilter.PART_OUT)  # -> GEO; plug-in component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
namefilter_2 = Wasp_FilterPartsByName(PART=stochasticaggregation.PART_OUT, NAME="B")  # -> PART_OUT, MASK; inputs PART: list, NAME: list; plug-in component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
partgeo_4 = Wasp_GetPartGeometry(PART=namefilter_2.PART_OUT)  # -> GEO; plug-in component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
namefilter_3 = Wasp_FilterPartsByName(PART=stochasticaggregation.PART_OUT, NAME="C")  # -> PART_OUT, MASK; inputs PART: list, NAME: list; plug-in component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
partgeo_5 = Wasp_GetPartGeometry(PART=namefilter_3.PART_OUT)  # -> GEO; plug-in component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
namefilter_4 = Wasp_FilterPartsByName(PART=stochasticaggregation.PART_OUT, NAME="E")  # -> PART_OUT, MASK; inputs PART: list, NAME: list; plug-in component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
partgeo_6 = Wasp_GetPartGeometry(PART=namefilter_4.PART_OUT)  # -> GEO; plug-in component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
area = Area(Geometry=partgeo)  # -> Area, Centroid
meshedgeselect = MeshEdgeSelect(mesh=[partgeo_3, partgeo_4, partgeo_5])  # -> out, outLine; inputs mesh: Mesh, angleLimit: Double
# ---------- meshedgeselect: C# ----------
    List<Line> meshLine = new List<Line>();
    mesh.FaceNormals.ComputeFaceNormals();
    for(int i = 0;i <= mesh.TopologyEdges.Count - 1;i++)
    {
      int[] faces = mesh.TopologyEdges.GetConnectedFaces(i);
      if(faces.Length == 2)
      {
        Vector3d v0 = mesh.FaceNormals[faces[0]];
        Vector3d v1 = mesh.FaceNormals[faces[1]];
        if(Vector3d.VectorAngle(v0, v1) > angleLimit / 180 * Math.PI)
        {
          meshLine.Add(mesh.TopologyEdges.EdgeLine(i));
        }
      }
      else
      {
        meshLine.Add(mesh.TopologyEdges.EdgeLine(i));
      }
     }
      outLine = meshLine;
# ---------- end meshedgeselect ----------
series = Series(Start="0", Step="1", Count=lng)
aggregationgraph = Wasp_AggregationGraph(AGGR=stochasticaggregation.AGGR, FG=Toggle(True), TOL=Slider(0.5, range=0..1), FR=Toggle(True), F=Toggle(True))  # -> G, N, E, ES_ID, EE_ID, CS_ID, CE_ID; inputs FG: Boolean, FR: Boolean, CR: list, F: Boolean; plug-in component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
preview = CustomPreview(Geometry=partgeo_4, Material=ColourSwatch(SwatchColor=RGBA(255, 185, 176, 100)))
preview_2 = CustomPreview(Geometry=partgeo_5, Material=ColourSwatch(SwatchColor=RGBA(255, 144, 89, 100)))
preview_3 = CustomPreview(Geometry=partgeo_3, Material=ColourSwatch(SwatchColor=RGBA(255, 233, 89, 100)))
preview_4 = CustomPreview(Geometry=partgeo_6, Material=ColourSwatch(SwatchColor=RGBA(97, 232, 134, 100)))
pdecon = Deconstruct(Point=area.Centroid)  # -> XComponent, YComponent, ZComponent
swatch = ColourSwatch(SwatchColor=RGB(0, 0, 0))
graph_nodes = Point(aggregationgraph.N)
graph_edges = Curve(aggregationgraph.E)
S = Script(
    path="C:\TD_GH_bridge\blocks.csv",
    write=Toggle(True),
    idxs=series,
    xs=flatten(pdecon.XComponent),
    ys=flatten(pdecon.YComponent),
    zs=flatten(pdecon.ZComponent))  # -> out, status; inputs xs: list, ys: list, zs: list
# ---------- S: Python ----------
import os
import csv

def flatten(v):
    result = []

    if v is None:
        return result

    # Grasshopper DataTree
    if hasattr(v, "Branches"):
        for branch in v.Branches:
            for item in branch:
                result.append(item)
        return result

    # Normal iterable
    try:
        if isinstance(v, str):
            return [v]
        for item in v:
            result.append(item)
        return result
    except:
        return [v]

def clean_number(v):
    if v is None:
        return None

    try:
        return float(v)
    except:
        return None

xs_list = flatten(xs)
ys_list = flatten(ys)
zs_list = flatten(zs)

count = min(len(xs_list), len(ys_list), len(zs_list))

written = 0
skipped = 0

if write:
    folder = os.path.dirname(path)

    if folder and not os.path.exists(folder):
        os.makedirs(folder)

    with open(path, "w", encoding="utf-8", newline="") as f:
        writer = csv.writer(f)

        writer.writerow([
            "id",
            "type",
            "x",
            "y",
            "z",
            "rx",
            "ry",
            "rz",
            "sx",
            "sy",
            "sz",
            "stable",
            "removed"
        ])

        for i in range(count):
            xi = clean_number(xs_list[i])
            yi = clean_number(ys_list[i])
            zi = clean_number(zs_list[i])

            if xi is None or yi is None or zi is None:
                skipped += 1
                continue

            writer.writerow([
                i,
                "A",
                xi,
                yi,
                zi,
                0,
                0,
                0,
                1,
                1,
                1,
                1,
                0
            ])

            written += 1

    status = "CSV written: {} rows, skipped {} rows".format(written, skipped)

else:
    status = "write is False, received {} coordinate rows".format(count)
# ---------- end S ----------
custom_preview_lineweights = CustomPreviewLineweights(Geometry=graph_edges, Shader=swatch, Thickness=Slider(5, range=0..10), Absolute=False)
custom_preview_lineweights_2 = CustomPreviewLineweights(
    Geometry=meshedgeselect.outLine,
    Shader=ColourSwatch(SwatchColor=RGB(255, 255, 255)),
    Thickness=Slider(4, range=0..10),
    Absolute=False)
mesh_sphere = MeshSphere(Base=graph_nodes, Radius=Slider(0.4, range=0..1), UCount=10, VCount=20)
preview_5 = CustomPreview(Geometry=graph_edges, Material=swatch)
preview_6 = CustomPreview(Geometry=mesh_sphere, Material=ColourSwatch(SwatchColor=RGB(255, 0, 0)))
panel_8 = Panel(S.status)
number_slider = Slider(71, range=0..100)
oscsender = OscSender(
    Send=Toggle(True),
    LocalIPAddress="127.0.0.1",
    LocalPort=10000,
    RemoteIPAddress="127.0.0.1",
    RemotePort=12345,
    Data=Slider(2.03, range=0..10),
    Tag="data",
    PacketSize=2048,
    BufferSize=600)
number_slider_2 = Slider(157, range=0..500)
panel_9 = Panel(oscsender)
oscreceiver_2 = OscReceiver(Receive=Toggle(True), KeepLastData=Toggle(True), IPAddress="127.0.0.1", Port="12346", PacketSize=2048, BufferSize=600)
panel_10 = Panel(oscreceiver_2)
